# Grasshopper definition example_i_1-1_jumpStep_3DWalker.gh (Grasshopper 1.0.8)
# plug-ins: RhinoCodePluginGH, Bifocals

# ----
# 1. click to reset
button = Button()

# ----
# 1. click to reset
button_2 = Button()

# ----
# 1. click to reset
button_3 = Button()

# ----
# 2. ^ click to run
trigger = Trigger(Interval=10, TimerInterval=10, Target=cs)  # disabled

# ----
# 2. ^ click to run
trigger_2 = Trigger(Interval=10, TimerInterval=10, Target=cs_2)  # disabled

# ----
# 2. ^ click to run
trigger_3 = Trigger(Interval=10, TimerInterval=10, Target=cs_3)  # disabled

# ---- group: output preview
pt = Point([Point(-1, 1, 0), Point(2, 4, 0), Point(1, 4, 0), Point(1, 5, 0), Point(2, 5, 0), Point(2, 6, 0)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])

# ---- group: group 1 / output preview
pt_2 = Point([Point(0, -1, 0), Point(2, -1, -1), Point(2, -1, -2), Point(2, 0, -2), Point(2, 0, -1), Point(3, 0, -1)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])

pt_3 = Point([Point(1, 0, 0), Point(1, 1, 0), Point(1, 1, -1), Point(1, 2, -1), Point(0, 2, -1), Point(0, 1, -1)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])

pt_4 = Point([Point(-1, -1, 0), Point(0, -1, 2), Point(-1, -2, 2), Point(0, -2, 2), Point(1, -3, 2), Point(0, -2, 1)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])

# ---- group: output preview
pt_5 = Point([Point(3, -1, 0), Point(5, -1, 0), Point(5, 1, 0), Point(2, 5, 0), Point(-1, 5, 0), Point(-1, 3, 0)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])

# ---- group: group2 / output preview
pt_6 = Point([Point(0, -1, 0), Point(0, -1, -1), Point(0, -2, -2), Point(0, -1, -2), Point(0, -1, -3), Point(0, 0, -3)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])

# ---- group: group2
pline = PolyLine(Vertices=pt_6, Closed=False)

# ----
# 3D Random Walker
cs = CSharpScript(reset=button)  # -> out, a; inputs reset: Boolean
# ---------- cs: C# ----------
/*
 * Code example for The Nature of Code (2024 Edition)
 * Daniel Shiffman
 * (https://natureofcode.com/)
 
 * Ported from p5.js by Yun-Chen Lee yclee@arch.nycu.edu.tw
 * (https://github.com/yunchen-lee/noc-2-rhino-grasshopper-csharp-port)
 */



// Grasshopper Script Instance
using System;
using System.Collections;
using System.Collections.Generic;
using System.Drawing;

using Rhino;
using Rhino.Geometry;

using Grasshopper;
using Grasshopper.Kernel;
using Grasshopper.Kernel.Data;
using Grasshopper.Kernel.Types;

public class Script_Instance : GH_ScriptInstance
{
  /* 
    Members:
      RhinoDoc RhinoDocument
      GH_Document GrasshopperDocument
      IGH_Component Component
      int Iteration

    Methods (Virtual & overridable):
      Print(string text)
      Print(string format, params object[] args)
      Reflect(object obj)
      Reflect(object obj, string method_name)
  */
  
  private void RunScript(bool reset, ref object a)
  {
    // Write your logic here
    if(reset){
        walker = new Walker();
    }
    else{
        walker.step();
        a = walker.pts_list;
    }
  }

  Walker walker;
  
  class Walker{
    public int px;
    public int py;
    public int pz;
    public List<Point3d> pts_list;
    Random rnd;

    public Walker(){
        px = 0;
        py = 0;
        pz = 0;
        pts_list = new List<Point3d>();
        rnd = new Random();
    }

    public void step(){
        int choice = (int) Math.Floor(rnd.NextDouble()*6);
        if (choice == 0) px++;
        else if(choice == 1) px--;
        else if(choice == 2) py++;
        else if(choice == 3) py--;
        else if(choice == 4) pz++;
        else pz--;

        pts_list.Add(new Point3d(px, py, pz));
    }
  }
}
# ---------- end cs ----------

# ---- group: remove duplicates from a list
cullpt = CullDuplicates(Points=cs.a, Tolerance=0.1, CullMode=3)  # -> Points, Indices, Valence

# ---- group: output preview
pt_7 = Point(cullpt.Points)

# ----
lng = ListLength(List=cullpt.Points)
panel = Panel(lng)

# ----
# Traditional 2D Random Walker
cs_2 = CSharpScript(reset=button_2)  # -> out, a; inputs reset: Boolean
# ---------- cs_2: C# ----------
/*
 * Code example for The Nature of Code (2024 Edition)
 * Daniel Shiffman
 * (https://natureofcode.com/)
 
 * Ported from p5.js by Yun-Chen Lee yclee@arch.nycu.edu.tw
 * (https://github.com/yunchen-lee/noc-2-rhino-grasshopper-csharp-port)
 */



// Grasshopper Script Instance
using System;
using System.Collections;
using System.Collections.Generic;
using System.Drawing;

using Rhino;
using Rhino.Geometry;

using Grasshopper;
using Grasshopper.Kernel;
using Grasshopper.Kernel.Data;
using Grasshopper.Kernel.Types;

public class Script_Instance : GH_ScriptInstance
{
  /* 
    Members:
      RhinoDoc RhinoDocument
      GH_Document GrasshopperDocument
      IGH_Component Component
      int Iteration

    Methods (Virtual & overridable):
      Print(string text)
      Print(string format, params object[] args)
      Reflect(object obj)
      Reflect(object obj, string method_name)
  */
  
  private void RunScript(bool reset, ref object a)
  {
    // Write your logic here
    if(reset){
        walker = new Walker();
    }
    else{
        walker.step();
        a = walker.pts_list;
    }
  }

  Walker walker;
  
  class Walker{
    public int px;
    public int py;
    public List<Point3d> pts_list;
    Random rnd;

    public Walker(){
        px = 0;
        py = 0;
        pts_list = new List<Point3d>();
        rnd = new Random();
    }

    public void step(){
        int choice = (int) Math.Floor(rnd.NextDouble()*4);
        if (choice == 0) px++;
        else if(choice == 1) px--;
        else if(choice == 2) py++;
        else py--;

        pts_list.Add(new Point3d(px, py, 0));
    }
  }
}
# ---------- end cs_2 ----------

# ---- group: remove duplicates from a list
cullpt_2 = CullDuplicates(Points=cs_2.a, Tolerance=0.1, CullMode=3)  # -> Points, Indices, Valence

# ---- group: output preview
pt_8 = Point(cullpt_2.Points)

# ----
lng_2 = ListLength(List=cullpt_2.Points)
panel_2 = Panel(lng_2)

# ----
# Jump-Step Walker
cs_3 = CSharpScript(reset=button_3)  # -> out, a; inputs reset: Boolean
# ---------- cs_3: C# ----------
/*
 * Code example for The Nature of Code (2024 Edition)
 * Daniel Shiffman
 * (https://natureofcode.com/)
 
 * Ported from p5.js by Yun-Chen Lee yclee@arch.nycu.edu.tw
 * (https://github.com/yunchen-lee/noc-2-rhino-grasshopper-csharp-port)
 */



// Grasshopper Script Instance
using System;
using System.Collections;
using System.Collections.Generic;
using System.Drawing;

using Rhino;
using Rhino.Geometry;

using Grasshopper;
using Grasshopper.Kernel;
using Grasshopper.Kernel.Data;
using Grasshopper.Kernel.Types;

public class Script_Instance : GH_ScriptInstance
{
  /* 
    Members:
      RhinoDoc RhinoDocument
      GH_Document GrasshopperDocument
      IGH_Component Component
      int Iteration

    Methods (Virtual & overridable):
      Print(string text)
      Print(string format, params object[] args)
      Reflect(object obj)
      Reflect(object obj, string method_name)
  */
  
  private void RunScript(bool reset, ref object a)
  {
    // Write your logic here
    if(reset){
        walker = new Walker();
    }
    else{
        walker.step();
        a = walker.pts_list;
    }
  }

  Walker walker;
  
  class Walker{
    public int px;
    public int py;
    public List<Point3d> pts_list;
    Random rnd;

    public Walker(){
        px = 0;
        py = 0;
        pts_list = new List<Point3d>();
        rnd = new Random();
    }

    public void step(){
        int choice = (int) Math.Floor(rnd.NextDouble()*8);
        if (choice == 0) px++;
        else if(choice == 1) px--;
        else if(choice == 2) py++;
        else if(choice == 3) py--;
        else if(choice == 4) px-=2;
        else if(choice == 5) px+=2;
        else if(choice == 6) py-=2;
        else py+=2;

        pts_list.Add(new Point3d(px, py, 0));
    }
  }
}
# ---------- end cs_3 ----------

# ---- group: remove duplicates from a list
cullpt_3 = CullDuplicates(Points=cs_3.a, Tolerance=0.1, CullMode=3)  # -> Points, Indices, Valence

# ----
lng_3 = ListLength(List=cullpt_3.Points)
panel_3 = Panel(lng_3)

# ---- group: output preview
pt_9 = Point(cullpt_3.Points)
